# Grasshopper definition packing_rect.gh (Grasshopper 1.0.7)

genes = GenePool(
    Decimals=2,
    Maximum=1,
    Minimum=0,
    Value=[0.7421034331, 0.2198719127, 0.7996653448, 0.6994767057, 0.29494194, 0.8381090573, 0.8818827504, 0.5025731262, 0.4003534319, 0.9806671096])
genes_2 = GenePool(
    Decimals=2,
    Maximum=1,
    Minimum=0,
    Value=[0.1067111362, 0.09596610027, 0.1214518194, 0.6006760684, 0.7100527914, 0.2737729467, 0.5373220311, 0.2102847566, 0.6403417935, 0.6260427039])

python = GhPythonScript()  # -> out, data_path
# ---------- python: Python ----------
import sys
import Rhino.Geometry as rh

### GET LOCAL PATH
gh_path = ghenv.Component.OnPingDocument().FilePath.split("\\")
print "Local GH path: {}".format(gh_path)

data_path = "\\".join(gh_path[:-1] + ["/Users/matthewheaton/Documents/GitHub/design-ai/docs/projects/packing/rooms.json"])
print "Local json path: {}".format(data_path)
# ---------- end python ----------
file = ReadFile(File=python.data_path, PerLineParse=False)
python_2 = GhPythonScript(file=file)  # -> out, names, areas, adjacencies
# ---------- python_2: Python ----------
import json

items = json.loads(file)

names = [item["name"] for item in items]
areas = [item["area"] for item in items]

adjacencies = [item["adjacency"] for item in items]
# ---------- end python_2 ----------

panel = Panel(python_2.areas)
remap = RemapNumbers(Value=genes, Source=Domain(0, 1), Target="0 to 10")  # -> Mapped, Clipped
remap_2 = RemapNumbers(Value=genes_2, Source=Domain(0, 1), Target="0 to 10")  # -> Mapped, Clipped
panel_2 = Panel(python_2.adjacencies)
sqrt = SquareRoot(Value=python_2.areas)
pt = ConstructPoint(XCoordinate=remap.Mapped, YCoordinate=remap_2.Mapped, ZCoordinate=0)
python_3 = GhPythonScript(
    pts=pt,
    max_iters=Slider(1000, range=0..1000),
    alpha=Slider(0.81, range=0..1),
    radii=sqrt,
    names=python_2.names,
    adjacencies=python_2.adjacencies)  # -> out, pts, rects, iters, names; inputs pts: list of Point3d, max_iters: Int32, radii: list, names: list, adjacencies: list
# ---------- python_3: Python ----------
import sys
import Rhino.Geometry as rh

### GET LOCAL PATH
gh_path = ghenv.Component.OnPingDocument().FilePath.split("\\")
print "Local GH path: {}".format(gh_path)

sys.path.append("/Users/matthewheaton/Documents/GitHub/design-ai/docs/projects/packing")

import packing

reload(packing)

###

rects, iters, names = packing.run(pts, radii, names, adjacencies, max_iters, alpha)
# ---------- end python_3 ----------
panel_3 = Panel(python_3.names)
panel_4 = Panel(python_3.iters)
bbox = BoundingBox(Content=python_3.rects, Plane=PlaneXY(0, 0, 0), UnionBox=True)  # -> Box, Box_2
tag = TextTag(Location=python_3.pts, Text=python_2.names)
vec2pt = Vector2Pt(PointA=pt, PointB=python_3.pts, Unitize=False)  # -> Vector, Length
wires = BrepWireframe(Brep=bbox.Box, Density=-1)
area = Area(Geometry=bbox.Box)  # -> Area, Centroid
geo = Geometry(python_3.rects)
vdis = VectorDisplay(Anchor=pt, Vector=vec2pt.Vector)
galapagos = Galapagos(fitness=area, gene=[genes, genes_2])
