# Grasshopper definition circlePacking.gh (Grasshopper 1.0.7)

genes = GenePool(
    Decimals=2,
    Maximum=1,
    Minimum=0,
    Value=[0.9581081071, 0.1900627535, 0.009003647607, 0.8438859083, 0.80550005, 0.6813506082, 0.93483546, 0.3025666402, 0.5148845471, 0.566757262])
genes_2 = GenePool(
    Decimals=2,
    Maximum=1,
    Minimum=0,
    Value=[0.9320802527, 0.6032990744, 0.3803885091, 0.8041744078, 0.6788305158, 0.3942992863, 0.1221837474, 0.3398971684, 0.868362006, 0.3692199355])
remap = RemapNumbers(Value=genes, Source=Domain(0, 1), Target="0 to 10")  # -> Mapped, Clipped
remap_2 = RemapNumbers(Value=genes_2, Source=Domain(0, 1), Target="0 to 10")  # -> Mapped, Clipped
radius = Slider(5.668, range=0..10)
max_iters = Slider(115, range=0..1150)
pt = ConstructPoint(XCoordinate=remap_2.Clipped, YCoordinate=remap.Mapped, ZCoordinate=0)
alpha = Slider(1.372, range=1..2)
python = GhPythonScript(pts=pt, max_iters=max_iters, radius=radius, alpha=alpha)  # -> out, pts, circles; inputs pts: list of Point3d, max_iters: Int32
# ---------- python: Python ----------
import Rhino.Geometry as rh

class Agent:

    def __init__(self, pt, r):

        self.cp = pt
        self.radius = r
        self.neighbors = []

    # method for adding another instance to a list of neighbors
    def add_neighbor(self, other):
        self.neighbors.append(other)

    # method for checking distance to other room object and moving apart if they are overlapping
    def collide(self, other):

        d = self.cp.DistanceTo(other.cp)
        
        thresh = 0

        if d < self.radius + other.radius:

            pt_2 = other.cp
            pt_1 = self.cp

            # get vector from self to other
            v = pt_2 - pt_1
            #print(v[0])
            
            #set threshold for vector strength
            thresh = abs(v[0]+v[1])
            #ignore iteration if under strength threshold
            if thresh <.001:
                pass
            
            else:

            # change vector magnitude to 1
                v.Unitize()
            # set magnitude to half the overlap distance
                v *= (self.radius + other.radius - d) / 2
            # multiply by alpha parameter to control
            # amount of movement at each time step
                v *= alpha

            # move other object
                t = rh.Transform.Translation(v)
                pt_2.Transform(t)

            # reverse vector and move self same amount
            # in opposite direction
                v.Reverse()
                t = rh.Transform.Translation(v)
                pt_1.Transform(t)
                
            return thresh
            

            
        
    # method for checking distance to other instance and moving closer if they are not touching
    def cluster(self, other):
     
        d = self.cp.DistanceTo(other.cp)
        
        thresh = 0
        
        #move if distance between points is greater than sum of radii
        if d > self.radius + other.radius:

            pt_2 = other.cp
            pt_1 = self.cp

            # get vector from self to other
            v = pt_2 - pt_1
            #print(v)


            thresh = abs(v[0]+v[1])
            if thresh <.001:
                pass
            
            else:

            # change vector magnitude to 1
                v.Unitize()
            # set magnitude to half the gap distance
                v *= (d - self.radius + other.radius) / 2
            # multiply by alpha parameter to control
            # amount of movement at each time step
                v *= alpha/20

            # move other object towards
                #v.Reverse()
                t = rh.Transform.Translation(v)
                pt_2.Transform(t)

            # move self same amount
            # in same direction
                #v.Reverse()
                t = rh.Transform.Translation(v)
                pt_1.Transform(t)
                
            return thresh
            
                
    def get_circle(self):
        return rh.Circle(self.cp, self.radius)

agents = []

for pt in pts:
    my_agent = Agent(pt, radius)
    agents.append(my_agent)

# for each agent in the list, add the previous agent as its neighbor
for i in range(len(agents)):
    agents[i].add_neighbor(agents[i-1])

for i in range(max_iters):
    
    thresh_both = 0
    
    for j,agent_1 in enumerate(agents):
        
        #print j
        
        #return thresh

        # cluster to all agent's neighbors
        for agent_2 in agent_1.neighbors:
            agent_1.cluster(agent_2)

        # collide with all agents after agent in list
        for agent_2 in agents[j+1:]:
            agent_1.collide(agent_2)
            
    if thresh_both < 0.001:
        print("busted")
        break
            

#print[i-1]            

circles = []

for agent in agents:
    circles.append(agent.get_circle())
# ---------- end python ----------
vec2pt = Vector2Pt(PointA=pt, PointB=python.pts, Unitize=False)  # -> Vector, Length
vdis = VectorDisplay(Anchor=pt, Vector=vec2pt.Vector)
